# Grasshopper definition pair up lists sample file.gh (Grasshopper 1.0.7)

pt = Point([Point(35, 0, 0), Point(35, 2, 0), Point(35, 4, 0)])
pt_2 = Point([Point(2.486685842, 1.107439772, 0.9340213597), Point(8.75821514, 7.961442879, 0.4404517982), Point(0.960044973, 9.516898365, 0.9651758973), Point(9.142282707, 0.9184793154, 1.504984329)])
pt_3 = Point([Point(2.486685842, 42.10743977, 0.9340213597), Point(8.75821514, 48.96144288, 0.4404517982), Point(0.960044973, 50.51689837, 0.9651758973), Point(9.142282707, 41.91847932, 1.504984329), Point(4.419897676, 47.22577073, 1.422511779), Point(9.71759215, 45.61340919, 1.807313576), Point(0.2311500303, 46.3325126, 0.4653467547), Point(6.131540014, 44.18363318, 0.8086947691), Point(5.983811182, 41.06206342, 1.120022301), Point(2.671958824, 44.85862071, 0.5989542429)])
pair_up = PairUpLists(list0=pt, list1=pt_2, list2=pt_3)  # -> new0, new1, new2; inputs list0: list, list1: list, list2: list
# ---------- pair_up: Python ----------
"""matches two lists so they can pair up
    Inputs:
        list1: first list
        list2: second list
    Output:
        new1: the new list1
        new2: the new list2"""
                        
__author__ = "crgarcia"
__version__ = "2021.11.30"
                        
import ghpythonlib.treehelpers as th
import Grasshopper.Kernel.Data as ghp
import Grasshopper as gh
import Grasshopper.DataTree as ghdt
from Grasshopper.Kernel import GH_ParamAccess as pa 
                
#print ghenv.Component.Params.Input.Count
        
        
ghenv.Component.Description = "Add lists as input"
        
#Generate the inputs with an specific name
listofL = []
acc = pa.list
for i,input in enumerate(ghenv.Component.Params.Input):
    ghenv.Component.Params.Input[i].Access = acc
    ghenv.Component.Params.Input[i].NickName = "list" + str(i)
    items=[]
    for item in input.VolatileData:
        items.append(item)
    listofL.append(items)
for i,output in enumerate(ghenv.Component.Params.Output):
    ghenv.Component.Params.Output[i].NickName = "new" + str(i)
        
#create a list of the lengths of the inputs
lengths = []
lengths_for_min = []
for i in listofL:
    lengths.append(len(i))
    if len(i) != 0:
        lengths_for_min.append(len(i))

#find the minimum length
minim=min(lengths_for_min)
        
#the function that pairs up lists
def nest_list(list,num1, num2):
    #transforms a list to an 2d array nested in python
    nestList=[]               
    start = 0
    end = num1
    if num2%num1 == 0:
        for i in range(int(num2/num1)): 
            nestList.append(list[start:end])
            start += num1
            end += num1
    else:
        for i in range(int((num2/num1)+1)): 
            nestList.append(list[start:end])
            start += num1
            end += num1
    return nestList
        
#create a list of the name of the outputs
out_name_list = []
for i,output in enumerate(ghenv.Component.Params.Output):
    out_name_list.append(ghenv.Component.Params.Output[i].NickName)



#for the script to run we introduce this condition
if ghenv.Component.Params.Input.Count == ghenv.Component.Params.Output.Count: 
    for m,n in enumerate(listofL):
        result = []
        ln = len(n)
        if ln==minim:
            name = str(out_name_list[m])
            #with this code we transform a string into a variable
            ey = th.list_to_tree(n)
            locals()[name] = ey
        elif n==0:
            name = str(out_name_list[m])
            locals()[name] = None
        else:
            lt = nest_list(n,minim,ln)
            result.append(lt)
            name = str(out_name_list[m])
            ey = th.list_to_tree(result)
            locals()[name] = ey

else:
    w = gh.Kernel.GH_RuntimeMessageLevel.Warning
    gh.Kernel.GH_RuntimeMessage(w,'The number of outputs must be the same as inputs')
# ---------- end pair_up ----------
ln = Line(StartPoint=pair_up.new0, EndPoint=pair_up.new1)
ln_2 = Line(StartPoint=pair_up.new0, EndPoint=pair_up.new2)
